# Grasshopper definition test.gh (Grasshopper 1.0.7)

crv = Curve([<curve referenced from the Rhino model> x5])
crv_2 = Curve([<curve referenced from the Rhino model> x5])
planar = Planar(Curve=crv)  # -> Planar, Plane, Deviation
area = Area(Geometry=crv)  # -> Area, Centroid
planar_2 = Planar(Curve=crv_2)  # -> Planar, Plane, Deviation
area_2 = Area(Geometry=crv_2)  # -> Area, Centroid
brep = Brep(<brep referenced from the Rhino model>)
c_script = CSharpScript(x=area.Centroid, y=planar.Plane)  # -> out, A; inputs x: Point3d, y: Plane
# ---------- c_script: C# ----------
    y.Origin = x;
    A = y;
# ---------- end c_script ----------
pline = PolyLine(Vertices=area.Centroid, Closed=False)
c_script_2 = CSharpScript(x=area_2.Centroid, y=planar_2.Plane)  # -> out, A; inputs x: Point3d, y: Plane; same code as c_script
pline_2 = PolyLine(Vertices=area_2.Centroid, Closed=False)
c_script_3 = CSharpScript(
    x=c_script_2.A,
    y=c_script.A,
    t=Slider(1, range=1..100),
    Reference="C:\Users\Administrator\Documents\GitHub\MeshClassLibrary\MathNet.Numerics\MathNet.Numerics.dll")  # -> out, A, B; inputs x: list of Plane, y: list of Plane, t: Double
# ---------- c_script_3: C# usings ----------
using MathNet.Numerics.LinearAlgebra.Double;
using MathNet.Numerics.LinearAlgebra.Generic;
using MathNet.Numerics.LinearAlgebra.Double.Factorization;
# ---------- c_script_3: C# ----------
    try{

      A = KabschEstimate(x, y, t);
    }catch(Exception ex){
      Print(ex.ToString());
    }
# ---------- c_script_3: C# additional code ----------
  public Transform KabschEstimate(List<Plane> P, List<Plane> Q, double NormalLength)
  {
    Transform output = Transform.Identity;
    if (P.Count != Q.Count) return output;
    List<Point3d> P1 = new List<Point3d>();
    List<Point3d> Q1 = new List<Point3d>();
    for (int i = 0; i < P.Count; i++)
    {
      P1.Add(new Point3d(P[i].Origin));
      Vector3d v1 = P[i].Normal;
      v1.Unitize(); v1 *= NormalLength;
      P1.Add(P[i].Origin + v1); P1.Add(P[i].Origin - v1);
      Q1.Add(new Point3d(Q[i].Origin));
      Vector3d v2 = Q[i].Normal;
      v2.Unitize(); v2 *= NormalLength;
      Q1.Add(Q[i].Origin + v1);Q1.Add(Q[i].Origin - v1);
    }
    return KabschEstimate(P1, Q1);
  }
  public Transform KabschEstimate(List<Point3d> P, List<Point3d> Q)
  {
            /*
            一组空间点匹配另一组空间点 kabsch算法
            将两组点的中心算出来 ，然后平移中点到原点
            协方差矩阵 H = X * Y.transpose();
            [U,S,VT]=SVD(H)
            I=(V*UT).Determinant判断方向
            旋转R = V*I*UT;
            平移T = -R * cenA + cenB;
            新点坐标P=P*T*R
            */
    Transform xf = Transform.Identity;
    if (P.Count != Q.Count) return xf;
    Point3d CenP = new Point3d(); Point3d CenQ = new Point3d();
    for (int i = 0; i < P.Count; i++)
    {
      CenP += P[i];
      CenQ += Q[i];
    }
    CenP /= P.Count; CenQ /= Q.Count;
    DenseMatrix MX = new DenseMatrix(P.Count, 3);
    DenseMatrix MY = new DenseMatrix(P.Count, 3);
    for (int i = 0; i < P.Count; i++)
    {
      DenseVector v1 = new DenseVector(3);
      DenseVector v2 = new DenseVector(3);
      v1[0] = P[i].X - CenP.X; v2[0] = Q[i].X - CenQ.X;
      v1[1] = P[i].Y - CenP.Y; v2[1] = Q[i].Y - CenQ.Y;
      v1[2] = P[i].Z - CenP.Z; v2[2] = Q[i].Z - CenQ.Z;
      MX.SetRow(i, v1); MY.SetRow(i, v2);
    }
    DenseMatrix H = DenseMatrix.OfMatrix(MX.TransposeThisAndMultiply(MY));
    Svd svd = H.Svd(true);
    Matrix<double> UT = svd.U().Transpose();
    Matrix<double> V = svd.VT().Transpose();
    Matrix<double> R = V.Multiply(UT);
    double d = R.Determinant();
    if (d > 0) { d = 1; } else { d = -1; }
    DenseMatrix I = new DenseMatrix(3, 3, new double[] { 1, 0, 0, 0, 1, 0, 0, 0, d });
    R = V.Multiply(I).Multiply(UT);
    xf.M00 = R[0, 0]; xf.M01 = R[0, 1]; xf.M02 = R[0, 2];
    xf.M10 = R[1, 0]; xf.M11 = R[1, 1]; xf.M12 = R[1, 2];
    xf.M20 = R[2, 0]; xf.M21 = R[2, 1]; xf.M22 = R[2, 2];
    CenP.Transform(xf);
    Transform tf = Transform.Translation(CenQ - CenP);
    return Transform.Multiply(tf, xf);
  }
# ---------- end c_script_3 ----------
transform = Transform(Geometry=brep, Transform=c_script_3.A)

crv_3 = Curve([<curve referenced from the Rhino model> x3])
crv_4 = Curve([<curve referenced from the Rhino model> x3])
planar_3 = Planar(Curve=crv_3)  # -> Planar, Plane, Deviation
area_3 = Area(Geometry=crv_3)  # -> Area, Centroid
planar_4 = Planar(Curve=crv_4)  # -> Planar, Plane, Deviation
area_4 = Area(Geometry=crv_4)  # -> Area, Centroid
brep_2 = Brep(<brep referenced from the Rhino model>)
c_script_4 = CSharpScript(x=area_3.Centroid, y=planar_3.Plane)  # -> out, A; inputs x: Point3d, y: Plane; same code as c_script
pline_3 = PolyLine(Vertices=area_3.Centroid, Closed=False)
c_script_5 = CSharpScript(x=area_4.Centroid, y=planar_4.Plane)  # -> out, A; inputs x: Point3d, y: Plane; same code as c_script
pline_4 = PolyLine(Vertices=area_4.Centroid, Closed=False)
c_script_6 = CSharpScript(
    x=c_script_5.A,
    y=c_script_4.A,
    t=Slider(1, range=1..100),
    Reference="C:\Users\Administrator\Documents\GitHub\MeshClassLibrary\MathNet.Numerics\MathNet.Numerics.dll")  # -> out, A, B; inputs x: list of Plane, y: list of Plane, t: Double; same code as c_script_3
transform_2 = Transform(Geometry=brep_2, Transform=c_script_6.A)

matrix = TransformMatrix(c_script_3.A, Digits=3)
panel = Panel(c_script_3.A)
